# Grasshopper definition cup-definition.gh (Grasshopper 1.0.7)

bottom_width = Slider(1.4, range=0..10)

construct_point = ConstructPoint(XCoordinate=bottom_width, YCoordinate=0, ZCoordinate=0)
# Make sure you click Display -> Preview Mesh Settings -> High Quality so things look pretty!
# Draw a horizontal line for the bottom, flat face of the cup.
construct_point_2 = ConstructPoint(XCoordinate=0, YCoordinate=0, ZCoordinate=0)
line = Line(StartPoint=construct_point_2, EndPoint=construct_point)

bottom_curvature = Slider(1.4, range=0..10)
top_radius = Slider(3.6, range=0..10)
cup_height = Slider(7.2, range=0..10)
cup_side_curvature = Slider(3.4, range=0..10)

unit_z = UnitZ(Factor=cup_side_curvature)
construct_point_3 = ConstructPoint(XCoordinate=top_radius, YCoordinate=0, ZCoordinate=cup_height)
unit_x = UnitX(Factor=bottom_curvature)
# Draw a curve for the cross-section of the cup with a bezier curve, which is defined by a beginning point, an end point, and two tangent pulls. These tangent pulls are sort of like the arrow handles in Illustrator’s curve controls.
negative = Negative(Value=unit_z)
bezier_span = BezierSpan(StartPoint=construct_point, StartTangent=unit_x, EndPoint=construct_point_3, EndTangent=negative)  # -> Curve, Length, Domain

construct_point_4 = ConstructPoint(XCoordinate=0, YCoordinate=0, ZCoordinate=Slider(1, range=0..1))
# Draw a vertical line around which we will 'spin' our curve to make the body surface of our cup. The '1' isn’t important, it could be any number greater than zero, and probably shoudn’t be a slider. Remmeber how to set a number directly?
construct_point_5 = ConstructPoint(XCoordinate=0, YCoordinate=0, ZCoordinate=0)
line_2 = Line(StartPoint=construct_point_5, EndPoint=construct_point_4)

# ----
# Connect the bottom of the cup line with the side curve.
join_curves = JoinCurves(Curves=[bezier_span.Curve, line], Preserve=False)
# Spin the joined curves around the vertical line to make a cup shaped surface.
revolution = Revolution(Curve=join_curves, Axis=line_2, Domain=Domain(0, 6.283185307))

# ----
# Duplicate the cup surface to make the inside of the cup, to create a wall-thickness.
negative_2 = Negative(Value=Slider(0.5, range=0..10))
offset = Offset(Surface=revolution, Distance=negative_2, Retrim=True)

# ----
# Find the open edges of both inner and outer cup surfaces (the top edges), and connect them with a flat surface
brep_edges = BrepEdges(Brep=revolution)  # -> Naked, Interior, NonManifold
brep_edges_2 = BrepEdges(Brep=offset)  # -> Naked, Interior, NonManifold
ruled_surface = RuledSurface(CurveA=brep_edges.Naked, CurveB=brep_edges_2.Naked)

# ----
# Flow our 3 surfaces together into a single node for organization.
geometry = Geometry([revolution, offset, ruled_surface])
# 'Flatten' our 3 surfaces so that Grasshopper doesn’t try to join the first 2 surfaces together and leave the last one alone.
flatten_tree = FlattenTree(Tree=geometry, Path="{0}")
# Join all the surfaces together!
brep_join = BrepJoin(Breps=flatten_tree)  # -> Breps, Closed
custom_preview = CustomPreview(Geometry=brep_join.Breps, Shader=ColourSwatch(SwatchColor=RGB(222, 231, 255)))
