# Grasshopper definition cubic-disarray-simple-definition.gh (Grasshopper 1.0.7)

number_of_squares_per_row = Slider(12, range=0..25)
number_of_rows = Slider(25, range=0..25)

# ----
# Make a grid of squares, which is natively *column-first*, and transpose it to be *row-first*
square = Square(Plane=PlaneXY(0, 0, 0), Size=1, ExtentX=number_of_squares_per_row, ExtentY=number_of_rows)  # -> Cells, Points
flip_matrix = FlipMatrix(Data=square.Cells)

# ----
# Range nodes always output one more data item than we want, so here we are generating the necessary (item count - 1) utility value to use throughout the definition.
panel = Panel("1")
subtraction = Subtraction(A=number_of_rows, B=panel)

max_rotation_for_final_row_in_degrees = Slider(57, range=0..100)
# Generate an increasing range of rotation maxes, one for each row.
radians = Radians(Degrees=max_rotation_for_final_row_in_degrees)
range = Range(Domain=radians, Steps=subtraction)

# ----
# Generate an increasing range of movement maxes, one for each row.
maximum_l_r_movement = Slider(0.5, range=0..1)
range_2 = Range(Domain=maximum_l_r_movement, Steps=subtraction)

# ----
# Find center of each square as origin point for rotations.
area = Area(Geometry=flip_matrix)  # -> Area, Centroid
# Make new random compositions!
random_seed = Slider(71, range=0..100)

# ----
# Allow squares to left OR right by creating a domain of possible movement amounts that begin at a negative number and end at the same positive number.
negative = Negative(Value=range_2)
construct_domain = ConstructDomain(DomainStart=negative, DomainEnd=range_2)

# ----
# Allow squares to rotate clockwise and counter-clockwise by creating a domain of possible rotation angles that begin at a negative number and end at the same positive number.
negative_2 = Negative(Value=range)
construct_domain_2 = ConstructDomain(DomainStart=negative_2, DomainEnd=range)

# ----
# To seed the random number generator, build a series of increasing integers and graft to match row list structure.
series = Series(Start=random_seed, Step=1, Count=number_of_rows)
graft_tree = GraftTree(Tree=series, IncludeEmptyLists=True, IncludeNullItems=True)

# ----
# Reverse the list of movement amounts so that the small movement values are at the end and big movement values are at the start. Then, make a single list for each domain so that the list structure matches our squares (one domain per row).
reverse_list = ReverseList(List=construct_domain)
graft_tree_2 = GraftTree(Tree=reverse_list, IncludeEmptyLists=True, IncludeNullItems=True)

# ----
# Reverse the list of rotation angles so that the small rotation angles are at the end and big rotation angles are at the start. Then, make a single list for each domain so that the list structure matches our squares (one domain per row).
reverse_list_2 = ReverseList(List=construct_domain_2)
graft_tree_3 = GraftTree(Tree=reverse_list_2, IncludeEmptyLists=True, IncludeNullItems=True)

# ----
# Generate a set of unique random movement values for each square in each row, based on unique seeds per row. Then, use those numbers to generate unique movement vectors in the x-dimension.
random = Random(Range=graft_tree_2, Number=number_of_squares_per_row, Seed=graft_tree)
vector_xyz = VectorXYZ(XComponent=random, YComponent=0, ZComponent=0)  # -> Vector, Length

# ----
# Generate a set of unique random rotation angles for each square in each row, based on unique seeds per row.
random_2 = Random(Range=graft_tree_3, Number=number_of_squares_per_row, Seed=graft_tree)
# Spin each square in place based on its semi-random rotation angle.
rotate = Rotate(Geometry=flip_matrix, Angle=random_2, Plane=area.Centroid)  # -> Geometry, Transform
# Move each square from its original grid location based on its semi-random movement value.
move = Move(Geometry=rotate.Geometry, Motion=vector_xyz.Vector)  # -> Geometry, Transform

custom_preview = CustomPreview(Geometry=move.Geometry, Material=ColourSwatch(SwatchColor=RGB(0, 0, 0)))

panel_2 = Panel("Preview edges.")
