# Grasshopper definition molnar.gh (Grasshopper 1.0.7)

# ---- group: Grid Settings
grid_height = Slider(1, range=0..10)
grid_width = Slider(1, range=0..10)
x_count = Slider(10, range=0..10)
y_count = Slider(10, range=0..10)

# ---- group: Grid of Points
series = Series(Start=0, Step=grid_height, Count=y_count)
series_2 = Series(Start=0, Step=grid_width, Count=x_count)
graft_tree = GraftTree(Tree=series, IncludeEmptyLists=True, IncludeNullItems=True)
construct_point = ConstructPoint(XCoordinate=series_2, YCoordinate=graft_tree, ZCoordinate=0)

# ---- group: Draw Rectangles in Grid
rectangle = Rectangle(Plane=construct_point, XSize=grid_width, YSize=grid_height, Radius=0)  # -> Rectangle, Length

# ---- group: Remove Tree Structure
flatten_tree = FlattenTree(Tree=rectangle.Rectangle, Path="{0}")

# ---- group: Generate Stream of Random Numbers for Each Cell
random_squares_per_grid_cell = Slider(10, range=0..10)
list_length = ListLength(List=flatten_tree)
series_3 = Series(Start=0, Step=1, Count=list_length)
random = Random(Range=Domain(0, 1), Number=random_squares_per_grid_cell, Seed=series_3)

# ---- group: Make Each Cell its Own Tree
graft_tree_2 = GraftTree(Tree=flatten_tree, IncludeEmptyLists=True, IncludeNullItems=True)

# ---- group: Scale Randomly from Center of Squares
area = Area(Geometry=graft_tree_2)  # -> Area, Centroid
scale = Scale(Geometry=graft_tree_2, Center=area.Centroid, Factor=random)  # -> Geometry, Transform

# ---- group: Remove Data Structure
flatten_tree_2 = FlattenTree(Tree=scale.Geometry, Path="{0}")

# ---- group: Create Domain from Negative Input to Positive Input for CW and CCW Spinning
rotation_max = Slider(10, range=0..100)
negative = Negative(Value=rotation_max)
construct_domain = ConstructDomain(DomainStart=negative, DomainEnd=rotation_max)

# ----
list_length_2 = ListLength(List=flatten_tree_2)

# ---- group: Find Area and Center of Each Square
area_2 = Area(Geometry=flatten_tree_2)  # -> Area, Centroid

# ---- group: Generate a Random Number for Each Square
random_2 = Random(Range=construct_domain, Number=list_length_2, Seed=2)
radians = Radians(Degrees=random_2)

# ---- group: Convert Rotation Values into Numbers between 0 and 1
bounds = Bounds(Numbers=radians)
remap_numbers = RemapNumbers(Value=radians, Source=bounds, Target=Domain(0, 1))  # -> Mapped, Clipped

# ---- group: Spin in Place
rotate = Rotate(Geometry=flatten_tree_2, Angle=radians, Plane=area_2.Centroid)  # -> Geometry, Transform

# ---- group: Preview with Gradient Colors
gradient = Gradient(
    LowerLimit=0,
    UpperLimit=1,
    Parameter=remap_numbers.Mapped,
    stops=[0: RGB(15, 91, 176), 0.273: RGB(148, 55, 255), 0.516: RGB(255, 147, 0), 0.835: RGB(0, 145, 146), 1: RGB(4, 50, 255)])
custom_preview = CustomPreview(Geometry=rotate.Geometry, Material=gradient)
