# Grasshopper definition ribbed-hull-definition.gh (Grasshopper 1.0.7)

# ---- group: Draw Curve Profile
construct_point = ConstructPoint(XCoordinate=Slider(6.4, range=0..10), YCoordinate=Slider(3.3, range=0..10), ZCoordinate=Slider(0, range=0..10))
construct_point_2 = ConstructPoint(XCoordinate=Slider(4.8, range=0..10), YCoordinate=Slider(10, range=0..10), ZCoordinate=Slider(0, range=0..10))
unit_x = UnitX(Factor=Slider(-8.9, range=-10..10))
unit_x_2 = UnitX(Factor=Slider(7.7, range=-10..10))
bezier_span = BezierSpan(StartPoint=construct_point, StartTangent=unit_x, EndPoint=construct_point_2, EndTangent=unit_x_2)  # -> Curve, Length, Domain

construct_point_3 = ConstructPoint(XCoordinate=Slider(0, range=0..10), YCoordinate=Slider(0.3, range=0..10), ZCoordinate=Slider(0, range=0..10))
unit_x_3 = UnitX(Factor=Slider(-3.1, range=-10..10))
construct_point_4 = ConstructPoint(XCoordinate=Slider(1.4, range=0..10), YCoordinate=Slider(8.2, range=0..10), ZCoordinate=Slider(0, range=0..10))
unit_x_4 = UnitX(Factor=Slider(2.6, range=-10..10))
bezier_span_2 = BezierSpan(StartPoint=construct_point_3, StartTangent=unit_x_3, EndPoint=construct_point_4, EndTangent=unit_x_4)  # -> Curve, Length, Domain

# ----
curve = Curve([bezier_span.Curve, bezier_span_2.Curve])
rib_count = Slider(17, range=0..100)

custom_preview = CustomPreview(Geometry=curve, Material=ColourSwatch(SwatchColor=RGB(116, 23, 178)))

# ---- group: Find Evenly Spaced Points along Curve
divide_curve = DivideCurve(Curve=bezier_span.Curve, Count=rib_count, Kinks=False)  # -> Points, Tangents, Parameters
divide_curve_2 = DivideCurve(Curve=bezier_span_2.Curve, Count=rib_count, Kinks=False)  # -> Points, Tangents, Parameters

# ---- group: Add more structure to lists of points for experimentation
# Try connecting the grafted versions of these lists of points to the arc start/end inputs to see what happens….
graft_tree = GraftTree(Tree=divide_curve.Points, IncludeEmptyLists=True, IncludeNullItems=True)
graft_tree_2 = GraftTree(Tree=divide_curve_2.Points, IncludeEmptyLists=True, IncludeNullItems=True)

# ----
# This node is called a “param viewer.” By default, it shows a textual display of the data structure. If you double-click on it, it will transform into the radial data structure visualizations you see below.
param_viewer = ParamViewer(divide_curve_2.Points)
param_viewer_2 = ParamViewer(graft_tree_2)

# ---- group: Draw Arcs
unit_z = UnitZ(Factor=1)
arc_sed = ArcSED(Start=divide_curve_2.Points, End=divide_curve.Points, Direction=unit_z)  # -> Arc, Plane, Radius

# ----
custom_preview_2 = CustomPreview(Geometry=arc_sed.Arc, Material=ColourSwatch(SwatchColor=RGB(0, 255, 94)))
