# Grasshopper definition substrate-definition.gh (Grasshopper 1.0.7)

# ---- group: Neighborhood Rectangle
rectangle = Rectangle(Plane=PlaneXY(0, 0, 0), XSize=Slider(3, range=0..10), YSize=Slider(8, range=0..10), Radius=0)  # -> Rectangle, Length

# ---- group: Possible Angles for Agent Movement
radians = Radians(Degrees=[Slider(0, range=0..100), Slider(20, range=0..100), Slider(40, range=0..100)])

# ---- group: Tarbell’s Substrate
random_composition = Slider(20, range=0..100)
line_count = Slider(70, range=0..100)
substrate = Substrate(Border=rectangle.Rectangle, Count=line_count, Angles=radians, Deviation=0, Seed=random_composition)

# ---- group: Convert Rectangle to Plane
boundary_surfaces = BoundarySurfaces(Edges=rectangle.Rectangle)

# ---- group: Cut up Plane with Substrate Lines
surface_split = SurfaceSplit(Surface=boundary_surfaces, Curves=substrate)

# ---- group: Get Outside Boundaries of Substrate Regions
brep_edges = BrepEdges(Brep=surface_split)  # -> Naked, Interior, NonManifold
join_curves = JoinCurves(Curves=brep_edges.Naked, Preserve=False)

# ---- group: Remove Structure
flatten_tree = FlattenTree(Tree=join_curves, Path="{0}")

# ---- group: Randomly Remove Curves from the List
removed_elements = Slider(13, range=0..100)
random_reduce = RandomReduce(List=flatten_tree, Reduction=removed_elements, Seed=1)

# ---- group: Generate Random Heights
max_height = Slider(5, range=0..10)
list_length = ListLength(List=random_reduce)
random = Random(Range=max_height, Number=list_length, Seed=2)
unit_z = UnitZ(Factor=random)

# ---- group: Make Boxes
extrude = Extrude(Base=random_reduce, Direction=unit_z)

# ---- group: Generate a Random Color for Each Box
list_length_2 = ListLength(List=extrude)
random_2 = Random(Range=Domain(0, 1), Number=list_length_2, Seed=2)
gradient = Gradient(
    LowerLimit=0,
    UpperLimit=1,
    Parameter=random_2,
    stops=[0: RGB(234, 38, 0), 0.25: RGB(234, 126, 0), 0.5: RGB(254, 244, 84), 0.75: RGB(173, 203, 249), 1: RGB(75, 107, 169)])

# ---- group: Put on Roofs and Floors
cap_holes = CapHoles(Brep=extrude)

# ----
custom_preview = CustomPreview(Geometry=cap_holes, Material=gradient)
