# Grasshopper definition unknown-pleasures-definition.gh (Grasshopper 1.0.7)

# ----
# Generate a regularly increasing stream of numbers from, by default, 0 to 1.
number_of_x_samples = Slider(70, range=0..100)
range = Range(Domain=Domain(0, 1), Steps=number_of_x_samples)

number_of_waves = Slider(46, range=0..100)

# ----
# 'Stretch-out' our x values by multiplying them by a common factor.
wave_width = Slider(2.9, range=0..10)
multiplication = Multiplication(A=wave_width, B=range)

# ----
# Make sure each wave gets its own random seed.
series = Series(Start=0, Step=1, Count=number_of_waves)
# Take the stream of x-values, and measure where they would fall on a complex, interactive curve for shaping purposes.
graph_mapper = GraphMapper(range, x0=0, x1=1, y0=0, y1=1, container_name="Gaussian", factor=0.04273831844, mean=0.5158292055, sdev=0.1026396751)

noise = Slider(0.142, range=0..1)
# Shuffle the order of the y-values to add noise to the curve.
jitter = Jitter(List=graph_mapper, Jitter=noise, Seed=series)  # -> Values, Indices

y_bounds = Slider(5.3, range=0..10)
panel = Panel("Expression \"x-1\"")
# Generate increasing movement vectors in the y-dimension to spread out the waves.
range_2 = Range(Domain=y_bounds, Steps=expr("x-1", number_of_waves))
unit_y = UnitY(Factor=range_2)

construct_point = ConstructPoint(XCoordinate=multiplication, YCoordinate=jitter.Values, ZCoordinate=0)
panel_2 = Panel("Plot points.")
# Make each y-movement vector its own list, to match the structure of our waves.
graft_tree = GraftTree(Tree=unit_y, IncludeEmptyLists=True, IncludeNullItems=True)
# Draw lines through points.
polyline = PolyLine(Vertices=construct_point, Closed=False)
# Stagger the waves based on the y-movement vectors.
move = Move(Geometry=polyline, Motion=graft_tree)  # -> Geometry, Transform

# ----
# Generate background rectangle.
flatten_tree = FlattenTree(Tree=move.Geometry, Path="{0}")
bounding_box = BoundingBox(Content=flatten(flatten_tree), Plane=PlaneXY(0, 0, 0), UnionBox=True)  # -> Box, Box_2

custom_preview = CustomPreview(Geometry=move.Geometry, Material=ColourSwatch(SwatchColor=RGB(255, 255, 255)))

panel_3 = Panel("Preview waves.")

margins = Slider(1.5, range=0..10)
area = Area(Geometry=bounding_box.Box)  # -> Area, Centroid
# Scale up background rectangle so that we have margins.
scale = Scale(Geometry=bounding_box.Box, Center=area.Centroid, Factor=margins)  # -> Geometry, Transform

# ----
# Preview background rectangle.
custom_preview_2 = CustomPreview(Geometry=scale.Geometry, Material=ColourSwatch(SwatchColor=RGB(0, 0, 0)))
