# Grasshopper definition attractor+repulsor-definition.gh (Grasshopper 1.0.7)

# ---- group: Draw Grid
grid_point_count = Slider(20, range=0..100)
overall_grid_size = Slider(12, range=0..100)
division = Division(A=overall_grid_size, B=grid_point_count)
square = Square(Plane=PlaneXY(0, 0, 0), Size=division, ExtentX=grid_point_count, ExtentY=grid_point_count)  # -> Cells, Points
flatten_tree = FlattenTree(Tree=square.Points, Path="{0}")

# ---- group: Attractor/Repulsor Point
construct_point = ConstructPoint(XCoordinate=Slider(2.41, range=0..10), YCoordinate=Slider(9.74, range=0..10), ZCoordinate=0)

# ---- group: Find the distance between attractor/repulsor point and every other point, and convert that number into a parameter between 0 and 1
distance = Distance(PointA=construct_point, PointB=flatten_tree)
bounds = Bounds(Numbers=distance)
remap_numbers = RemapNumbers(Value=distance, Source=bounds, Target=Domain(0, 1))  # -> Mapped, Clipped

# ---- group: To flip the gradient, replace the "Paramete" input with "Result" output
subtraction = Subtraction(A="1", B=remap_numbers.Mapped)

# ---- group: How big should the nearest and farthest spheres be?
construct_domain = ConstructDomain(DomainStart=Slider(0.4, range=0..1), DomainEnd=Slider(0.04, range=0..1))
remap_numbers_2 = RemapNumbers(Value=remap_numbers.Mapped, Source=Domain(0, 1), Target=construct_domain)  # -> Mapped, Clipped

# ---- group: How should the near and far points move?
construct_domain_2 = ConstructDomain(DomainStart=Slider(2.3, range=0..10), DomainEnd=Slider(5.3, range=0..10))
remap_numbers_3 = RemapNumbers(Value=remap_numbers.Mapped, Source=Domain(0, 1), Target=construct_domain_2)  # -> Mapped, Clipped

# ---- group: Sample a gradient to color the spheres based on distance
gradient = Gradient(
    LowerLimit=0,
    UpperLimit=1,
    Parameter=remap_numbers.Mapped,
    stops=[0: RGB(0, 98, 0), 0.25: RGB(81, 175, 17), 0.5: RGB(159, 198, 146), 1: RGB(221, 255, 53)])

# ---- group: In what direction should the grid points move and how far?
vector_2pt = Vector2Pt(PointA=construct_point, PointB=flatten_tree, Unitize=False)  # -> Vector, Length
amplitude = Amplitude(Vector=vector_2pt.Vector, Amplitude=remap_numbers_3.Mapped)
move = Move(Geometry=flatten_tree, Motion=amplitude)  # -> Geometry, Transform

# ----
sphere = Sphere(Base=move.Geometry, Radius=remap_numbers_2.Mapped)
custom_preview = CustomPreview(Geometry=sphere, Shader=gradient)
