# Grasshopper definition circles-definition.gh (Grasshopper 1.0.7)

# ---- group: Draw grid of points
grid_points = Slider(15, range=0..100)
overall_grid_size = Slider(12, range=0..100)
division = Division(A=overall_grid_size, B=grid_points)
square = Square(Plane=PlaneXY(0, 0, 0), Size=division, ExtentX=grid_points, ExtentY=grid_points)  # -> Cells, flatten(Points)
flatten_tree = FlattenTree(Tree=square.Points, Path="{0}")

# ---- group: Movable Circle Sizer
construct_point = ConstructPoint(XCoordinate=Slider(7.3, range=0..10), YCoordinate=Slider(6.7, range=0..10), ZCoordinate=0)

# ----
grid = Point(flatten_tree)

# ---- group: Find distance between each grid point and sizing circle
distance = Distance(PointA=construct_point, PointB=grid)

# ---- group: Convert distances to a parameter between 0 and 1
bounds = Bounds(Numbers=distance)
remap_numbers = RemapNumbers(Value=distance, Source=bounds, Target=Domain(0, 1))  # -> Mapped, Clipped

# ---- group: Map distances to Radii
construct_domain = ConstructDomain(DomainStart=Slider(0.36, range=0..1), DomainEnd=Slider(0.01, range=0..0.1))
remap_numbers_2 = RemapNumbers(Value=remap_numbers.Mapped, Source=Domain(0, 1), Target=construct_domain)  # -> Mapped, Clipped

# ---- group: Map distance to colors
gradient = Gradient(LowerLimit=0, UpperLimit=1, Parameter=remap_numbers.Mapped, stops=[0.15: RGB(255, 130, 160), 0.85: RGB(220, 0, 40)])

# ----
circle = Circle(Plane=grid, Radius=remap_numbers_2.Mapped)

# ---- group: Draw circles colored by distance from control point
boundary_surfaces = BoundarySurfaces(Edges=circle)
custom_preview = CustomPreview(Geometry=boundary_surfaces, Shader=gradient)
