# Grasshopper definition deformable-mesh-definition.gh (Grasshopper 1.0.7)

# ---- group: Make Grid
grid_width = Slider(10, range=0..10)
grid_counts = Slider(37, range=0..100)
division = Division(A=grid_width, B=grid_counts)
hexagonal = Hexagonal(Plane=PlaneXY(0, 0, 0), Size=expr("x/2", division), ExtentX=grid_counts, ExtentY=grid_counts)  # -> Cells, Points
panel = Panel("x/2")

# ---- group: Movable Point
construct_point = ConstructPoint(XCoordinate=Slider(2.6, range=0..10), YCoordinate=Slider(2.5, range=0..10), ZCoordinate=0)

# ---- group: Remove Structure
flatten_tree = FlattenTree(Tree=hexagonal.Points, Path="{0}")

# ---- group: Find Distance from Movable Point to All Other Points
distance = Distance(PointA=flatten_tree, PointB=construct_point)

# ---- group: Find Biggest and Smallest Distance
bounds = Bounds(Numbers=distance)

# ---- group: Transform Distance Numbers into Percentages
remap_numbers = RemapNumbers(Value=distance, Source=bounds, Target=Domain(0, 1))  # -> Mapped, Clipped

# ----
graph_mapper = GraphMapper(
    remap_numbers.Mapped,
    x0=0,
    x1=1,
    y0=0,
    y1=1,
    container_name="Sinc",
    Equation_X0=0.470090121,
    Equation_X1=0.6,
    Equation_Y0=0.4246804118,
    Equation_Y1=0.3)

# ---- group: Create Movement Vector
max_z_height = Slider(5.4, range=0..10)
multiplication = Multiplication(A=graph_mapper, B=max_z_height)
unit_z = UnitZ(Factor=multiplication)

# ---- group: Shift Points Up
move = Move(Geometry=flatten_tree, Motion=unit_z)  # -> Geometry, Transform

# ---- group: Make 3D Mesh from Points
delaunay_mesh = DelaunayMesh(Points=move.Geometry, Plane=PlaneXY(0, 0, 0))

# ----
custom_preview = CustomPreview(Geometry=delaunay_mesh, Material=ColourSwatch(SwatchColor=RGB(72, 108, 255)))
