# Grasshopper definition walker-definition.gh (Grasshopper 1.0.4)

# ---- group: Draw Point Grid
overall_grid_size = Slider(12, range=0..100)
grid_point_count = Slider(12, range=0..100)
division = Division(A=overall_grid_size, B=grid_point_count)
square = Square(Plane=PlaneXY(0, 0, 0), Size=division, ExtentX=grid_point_count, ExtentY=grid_point_count)  # -> Cells, Points
flatten_tree = FlattenTree(Tree=square.Points, Path="{0}")

# ---- group: Walker center point
construct_point = ConstructPoint(XCoordinate=Slider(5.8, range=0..10), YCoordinate=Slider(8.1, range=0..10), ZCoordinate=0)

# ---- group: How Many Closest Points?
closest_point_count = Slider(12, range=0..100)
closest_points = ClosestPoints(Point=construct_point, Cloud=flatten_tree, Count=closest_point_count)  # -> ClosestPoint, CPIndex, Distance

# ---- group: Create domain of max and min distances
distance = Distance(PointA=construct_point, PointB=flatten_tree)
sort_list = SortList(Keys=distance)  # -> Keys, ValuesA
reverse_list = ReverseList(List=sort_list.Keys)
list_item = ListItem(List=sort_list.Keys, Index=0, Wrap=True)
list_item_2 = ListItem(List=reverse_list, Index=0, Wrap=True)
construct_domain = ConstructDomain(DomainStart=list_item, DomainEnd=list_item_2)

# ---- group: Map distances to color values
remap_numbers = RemapNumbers(Value=distance, Source=construct_domain, Target="255")  # -> Mapped, Clipped
colour_rgb = ColourRGB(Alpha=255, Red=expr("255-x", remap_numbers.Mapped), Green=0, Blue=remap_numbers.Mapped)

# ---- group: Draw Lines to Close Points and Draw Boundary Polygon
# Right click on the 'Red Input' and note the Expression…
convex_hull = ConvexHull(Points=closest_points.ClosestPoint, Plane=PlaneXY(0, 0, 0))  # -> Hull, HullZ, Indices
line = Line(StartPoint=construct_point, EndPoint=closest_points.ClosestPoint)
curve = Curve([convex_hull.Hull, line])

# ---- group: Draw spheres colored by distance from control point
sphere_size = Slider(0.3, range=0..1)
sphere = Sphere(Base=flatten_tree, Radius=sphere_size)
custom_preview = CustomPreview(Geometry=sphere, Shader=colour_rgb)
