# Grasshopper definition delaunay-definition.gh (Grasshopper 1.0.4)

# ---- group: Random Points
populate_2d = Populate2D(Region={Plane=PlaneXY(0, 0, 0), Size=Domain2(u=0..20, v=0..10)}, Count=Slider(20, range=0..20), Seed=1)

# ----
panel = Panel("https://www.grasshopper3d.com/forum/topics/cross-reference-what-is-it-how-does-it-work-why-would-i-need-it")

# ---- group: Make a list from each point to all other points
cross_reference = CrossReference(ListListA=populate_2d, ListListB=populate_2d, ListC=populate_2d, CrossMode=5)  # -> ListListA, ListListB, ListC

# ---- group: Make each point its own *branch* in the data structure
graft_tree = GraftTree(Tree=cross_reference.ListListB, IncludeEmptyLists=True, IncludeNullItems=True)
graft_tree_2 = GraftTree(Tree=cross_reference.ListListA, IncludeEmptyLists=True, IncludeNullItems=True)
graft_tree_3 = GraftTree(Tree=cross_reference.ListC, IncludeEmptyLists=True, IncludeNullItems=True)

# ---- group: Make a circle for each set of 3 points
circle_3pt = Circle3Pt(PointA=graft_tree_2, PointB=graft_tree, PointC=graft_tree_3)  # -> Circle, Plane, Radius

# ---- group: Collect points in sets of 3s
point = Point([graft_tree_2, graft_tree, graft_tree_3])

# ---- group: Check if the circles include any of the points
point_in_curve = PointInCurve(Point=populate_2d, Curve=circle_3pt.Circle)  # -> Relationship, Point

# ---- group: If a circle includes a point, point in curve will output a '2'
equality = Equality(FirstNumber=point_in_curve.Relationship, SecondNumber="2")  # -> Equality, Inequality
mass_addition = MassAddition(Input=equality.Equality)  # -> Result, PartialResults

# ---- group: Draw all triangles
polyline = PolyLine(Vertices=point, Closed=True)

# ---- group: Only include circles that have no included points
equality_2 = Equality(FirstNumber=mass_addition.Result, SecondNumber="0")  # -> Equality, Inequality

# ---- group: Remove triangles if the matching circle failed the point inclusion test
cull_pattern = CullPattern(List=polyline, CullPattern=equality_2.Equality)

# ---- group: Delaunay
flatten_tree = FlattenTree(Tree=cull_pattern, Path="{0}")
