# Grasshopper definition seed-cathedral-definition.gh (Grasshopper 1.0.7)
# plug-ins: Weaverbird

# ---- group: Create Smooth Mesh Boxoid
number_slider = Slider(8, range=0..10)
mesh_box = MeshBox(
    Base={Plane=PlaneXY(0, 0, 0), X=Domain(-10, 10), Y=Domain(-10, 10), Z=Domain(-10, 10)},
    XCount=number_slider,
    YCount=number_slider,
    ZCount=number_slider)
weaverbird_s_catmull_clark_subdivision = WeaverbirdsCatmullClarkSubdivision(MeshCurves=mesh_box, Level=1, SmoothNakedEdges=1)

# ----
construct_point = ConstructPoint(XCoordinate=Slider(0, range=-10..10), YCoordinate=Slider(0, range=-10..10), ZCoordinate=Slider(0, range=-10..10))
construct_point_2 = ConstructPoint(XCoordinate=Slider(-8, range=-20..10), YCoordinate=Slider(-5, range=-10..10), ZCoordinate=Slider(1.2, range=-10..10))
construct_point_3 = ConstructPoint(XCoordinate=Slider(-9.2, range=-10..10), YCoordinate=Slider(0, range=-10..10), ZCoordinate=Slider(-7.1, range=-10..10))

# ---- group: Take Apart Mesh into Constituent Parts
deconstruct_mesh = DeconstructMesh(Mesh=weaverbird_s_catmull_clark_subdivision)  # -> Vertices, Faces, Colours, Normals

# ---- group: Find the nearest point in a set of attractors, and calculate the distance
construct_point_4 = ConstructPoint(XCoordinate=Slider(0, range=-10..10), YCoordinate=Slider(0, range=-10..10), ZCoordinate=Slider(0, range=-10..10))
# “Closest Point” node could be replaced with a simple “Distance” node if we did not need the potential use of multiple attractor points.
closest_point = ClosestPoint(Point=deconstruct_mesh.Vertices, Cloud=construct_point_4)  # -> ClosestPoint, CPIndex, Distance

# ----
# <- Connect to “Cloud” Input of Closest Point Node for Multiple Attractors
point = Point([construct_point, construct_point_2, construct_point_3])

# ---- group: Remap distances from box points to attractor points to a new numerical domain
construct_domain = ConstructDomain(DomainStart=Slider(12.3, range=0..20), DomainEnd=Slider(16.8, range=0..20))
bounds = Bounds(Numbers=closest_point.Distance)
remap_numbers = RemapNumbers(Value=closest_point.Distance, Source=bounds, Target=construct_domain)  # -> Mapped, Clipped

construct_domain_2 = ConstructDomain(DomainStart=Slider(3.4, range=0..10), DomainEnd=Slider(1.6, range=0..10))
bounds_2 = Bounds(Numbers=closest_point.Distance)
remap_numbers_2 = RemapNumbers(Value=closest_point.Distance, Source=bounds_2, Target=construct_domain_2)  # -> Mapped, Clipped

# ---- group: Construct the direction from the attractor point to its nearest points
vector_2pt = Vector2Pt(PointA=deconstruct_mesh.Vertices, PointB=closest_point.ClosestPoint, Unitize=False)  # -> Vector, Length

# ----
line_sdl = LineSDL(Start=closest_point.ClosestPoint, Direction=vector_2pt.Vector, Length=remap_numbers.Mapped)

# ---- group: Adjust length of vector based on attractor domain
amplitude = Amplitude(Vector=vector_2pt.Vector, Amplitude=remap_numbers_2.Mapped)

# ----
custom_preview = CustomPreview(Geometry=line_sdl, Material=ColourSwatch(SwatchColor=RGB(255, 255, 255)))

# ---- group: Move Mesh Points
move = Move(Geometry=deconstruct_mesh.Vertices, Motion=amplitude)  # -> Geometry, Transform

# ---- group: Put Mesh back Together
construct_mesh = ConstructMesh(Vertices=move.Geometry, Faces=deconstruct_mesh.Faces)

# ---- group: Create Translucent Color
number_slider_2 = Slider(0.5, range=0..1)
colour_rgb_f = ColourRGBF(Alpha=Slider(0.325, range=0..1), Red=0, Green=number_slider_2, Blue=number_slider_2)

# ---- group: Smooth Mesh Again
weaverbird_s_catmull_clark_subdivision_2 = WeaverbirdsCatmullClarkSubdivision(MeshCurves=construct_mesh, Level=1, SmoothNakedEdges=1)

# ----
custom_preview_2 = CustomPreview(Geometry=weaverbird_s_catmull_clark_subdivision_2, Material=colour_rgb_f)
