# Grasshopper definition simple-definition.gh (Grasshopper 1.0.7)

# ---- group: Boundary Rectangle
rectangle = Rectangle(Plane=PlaneXY(0, 0, 0), XSize=Slider(10, range=0..10), YSize=Slider(5, range=0..10), Radius=0)  # -> Rectangle, Length

# ---- group: Generate Random Points
populate_2d = Populate2D(Region=rectangle.Rectangle, Count=100, Seed=1)

# ---- group: Calculate Voronoi and Delaunay Nets
delaunay_edges = DelaunayEdges(Points=populate_2d, Plane=PlaneXY(0, 0, 0))  # -> Connectivity, Edges
voronoi = Voronoi(Points=populate_2d, Boundary=rectangle.Rectangle, BruteForceOverride=False)

# ---- group: Find Color Based on Area of Voronoi Cells
area = Area(Geometry=voronoi)  # -> Area, Centroid
bounds = Bounds(Numbers=area.Area)
remap_numbers = RemapNumbers(Value=area.Area, Source=bounds, Target=Domain(0, 1))  # -> Mapped, Clipped
gradient = Gradient(
    LowerLimit=0,
    UpperLimit=1,
    Parameter=remap_numbers.Mapped,
    stops=[0: RGB(80, 55, 25), 0.5: RGB(159, 65, 29), 1: RGB(174, 166, 129)])

# ----
custom_preview = CustomPreview(Geometry=delaunay_edges.Edges, Material=ColourSwatch(SwatchColor=RGB(0, 0, 0)))

# ---- group: Create Surface from Each Cell
boundary_surfaces = BoundarySurfaces(Edges=voronoi)

# ----
custom_preview_2 = CustomPreview(Geometry=boundary_surfaces, Material=gradient)
