# Grasshopper definition voronoi-attractor-definition.gh (Grasshopper 1.0.7)

# ---- group: Draw Grid of Points
x_count = Slider(30, range=0..100)
y_count = Slider(15, range=0..100)
width = Slider(10, range=0..10)
division = Division(A=width, B=x_count)
square = Square(Plane=PlaneXY(0, 0, 0), Size=division, ExtentX=x_count, ExtentY=y_count)  # -> Cells, Points
flatten_tree = FlattenTree(Tree=square.Points, Path="{0}")

# ---- group: Attractor Points
construct_point = ConstructPoint(XCoordinate=Slider(6.7, range=0..10), YCoordinate=Slider(2.5, range=0..10), ZCoordinate=0)
construct_point_2 = ConstructPoint(XCoordinate=Slider(5.9, range=0..10), YCoordinate=Slider(0, range=0..10), ZCoordinate=0)
construct_point_3 = ConstructPoint(XCoordinate=Slider(1.3, range=0..10), YCoordinate=Slider(4.7, range=0..10), ZCoordinate=0)
point = Point([construct_point, construct_point_2, construct_point_3])

# ---- group: Draw Spheres on Each Attractor Points
sphere = Sphere(Base=point, Radius=Slider(0.126, range=0..1))
custom_preview = CustomPreview(Geometry=sphere, Material=ColourSwatch(SwatchColor=RGB(255, 255, 255)))

# ---- group: Find Closest Attractor Point for Each Grid Point
closest_point = ClosestPoint(Point=flatten_tree, Cloud=point)  # -> ClosestPoint, CPIndex, Distance

# ---- group: Split List Up Based on Closest Point
sift_pattern = SiftPattern(List=flatten_tree, SiftPattern=closest_point.CPIndex)  # -> Output0, Output1, Output2

# ---- group: Color Radiating Lines
line = Line(StartPoint=flatten_tree, EndPoint=closest_point.ClosestPoint)
custom_preview_2 = CustomPreview(Geometry=line, Material=ColourSwatch(SwatchColor=RGB(255, 255, 255)))

# ---- group: Draw Polygonal Bounds
convex_hull = ConvexHull(Points=sift_pattern.Output1, Plane=PlaneXY(0, 0, 0))  # -> Hull, HullZ, Indices
convex_hull_2 = ConvexHull(Points=sift_pattern.Output2, Plane=PlaneXY(0, 0, 0))  # -> Hull, HullZ, Indices
convex_hull_3 = ConvexHull(Points=sift_pattern.Output0, Plane=PlaneXY(0, 0, 0))  # -> Hull, HullZ, Indices

# ---- group: Create Surface from each Boundary
boundary_surfaces = BoundarySurfaces(Edges=[convex_hull_3.Hull, convex_hull.Hull, convex_hull_2.Hull])

# ---- group: Generate Color Based on Area
area = Area(Geometry=boundary_surfaces)  # -> Area, Centroid
bounds = Bounds(Numbers=area.Area)
remap_numbers = RemapNumbers(Value=area.Area, Source=bounds, Target=Domain(0, 1))  # -> Mapped, Clipped
gradient = Gradient(
    LowerLimit=0,
    UpperLimit=1,
    Parameter=remap_numbers.Mapped,
    stops=[0: RGB(234, 38, 0), 0.25: RGB(234, 126, 0), 0.5: RGB(254, 244, 84), 0.75: RGB(173, 203, 249), 1: RGB(75, 107, 169)])

# ----
custom_preview_3 = CustomPreview(Geometry=boundary_surfaces, Material=gradient)
