# Grasshopper definition parachute-definition.gh (Grasshopper 1.0.7)

secret_nasa_parachute_message = Panel("""11111111111111111111000000010000000000010000010010000000010100011111111111111111
00000001110000001000000001010000000110010001111111111111111100000011010000001001
00000001110000010011000111111111111111110000010100000000100000000010010000001110
00000111110000010111000010001000000010110000111010000000111000011101100000001010""")
image_sampler = ImageSampler(
    FilePath="/Users/zap/Downloads/oetbsw7g33j61.jpg",
    Filter="Colour",
    Interpolate=False,
    Umax=1,
    Umin=0,
    Vmax=1,
    Vmin=0,
    Wrap=1)

# ---- group: Count 0s and 1s - Number of Slices
text_length = TextLength(Text=secret_nasa_parachute_message)
list_item = ListItem(List=text_length, Index=0, Wrap=True)

# ---- group: Count Branches - Number of Rings
tree_statistics = TreeStatistics(Tree=secret_nasa_parachute_message)  # -> Paths, Length, Count

# ---- group: Split text into branches of individual characters
characters = Characters(Text=secret_nasa_parachute_message)  # -> Result, Unicode

# ---- group: Convert 10-Bit Binary Strings to Decimal Numbers
number_slider = Slider(10, range=0..10)
series = Series(Start=0, Step=1, Count=number_slider)
partition_list = PartitionList(List=characters.Result, Size=number_slider)  # -> simplify(Chunks)
reverse_list = ReverseList(List=series)
power = Power(A="2", B=reverse_list)
multiplication = Multiplication(A=partition_list, B=power)
mass_addition = MassAddition(Input=multiplication)  # -> Result, PartialResults

# ---- group: Draw Radial grid
radial = Radial(Plane=PlaneXY(0, 0, 0), Size=1, ExtentR=tree_statistics.Length, ExtentP=list_item)  # -> simplify(Cells), Points

# ---- group: 10-Bit Binary Strings
text_join = TextJoin(Text=partition_list)
panel = Panel(text_join)

# ---- group: Split the radial grid up into 0 (white) and 1 (orange) segments
sift_pattern = SiftPattern(List=radial.Cells, SiftPattern=characters.Result)  # -> Output0, Output1

# ---- group: CSV of ASCII Codes
panel_2 = Panel("""0,00,00000000,&#0;,NUL,Null
1,01,00000001,&#1;,SOH,Start of Header
2,02,00000010,&#2;,STX,Start of Text
3,03,00000011,&#3;,ETX,End of Text
4,04,00000100,&#4;,EOT,End of Transmission
5,05,00000101,&#5;,ENQ,Enquiry
6,06,00000110,&#6;,ACK,Acknowledge
7,07,00000111,&#7;,BEL,Bell
8,08,00001000,&#8;,BS,Backspace
9,09,00001001,&#9;,HT,Horizontal Tab
10,0A,00001010,&#10;,LF,Line Feed
11,0B,00001011,&#11;,VT,Vertical Tab
12,0C,00001100,&#12;,FF,Form Feed
13,0D,00001101,&#13;,CR,Carriage Return
14,0E,00001110,&#14;,SO,Shift Out
15,0F,00001111,&#15;,SI,Shift In
16,10,00010000,&#16;,DLE,Data Link Escape
17,11,00010001,&#17;,DC1,Device Control 1
18,12,00010010,&#18;,DC2,Device Control 2
19,13,00010011,&#19;,DC3,Device Control 3
20,14,00010100,&#20;,DC4,Device Control 4
21,15,00010101,&#21;,NAK,Negative Acknowledge
22,16,00010110,&#22;,SYN,Synchronize
23,17,00010111,&#23;,ETB,End of Transmission Block
24,18,00011000,&#24;,CAN,Cancel
25,19,00011001,&#25;,EM,End of Medium
26,1A,00011010,&#26;,SUB,Substitute
27,1B,00011011,&#27;,ESC,Escape
28,1C,00011100,&#28;,FS,File Separator
29,1D,00011101,&#29;,GS,Group Separator
30,1E,00011110,&#30;,RS,Record Separator
31,1F,00011111,&#31;,US,Unit Separator
32,20,00100000,&#32;,space,Space
33,21,00100001,&#33;,!,Exclamation mark
34,22,00100010,&#34;,",Double quote
35,23,00100011,&#35;,#,Number
36,24,00100100,&#36;,$,Dollar sign
37,25,00100101,&#37;,%,Percent
38,26,00100110,&#38;,&,Ampersand
39,27,00100111,&#39;,',Single quote
40,28,00101000,&#40;,(,Left parenthesis
41,29,00101001,&#41;,),Right parenthesis
42,2A,00101010,&#42;,*,Asterisk
43,2B,00101011,&#43;,+,Plus
44,2C,00101100,&#44;,;,Comma
45,2D,00101101,&#45;,-,Minus
46,2E,00101110,&#46;,.,Period
47,2F,00101111,&#47;,/,Slash
48,30,00110000,&#48;,0,Zero
49,31,00110001,&#49;,1,One
50,32,00110010,&#50;,2,Two
51,33,00110011,&#51;,3,Three
52,34,00110100,&#52;,4,Four
53,35,00110101,&#53;,5,Five
54,36,00110110,&#54;,6,Six
55,37,00110111,&#55;,7,Seven
56,38,00111000,&#56;,8,Eight
57,39,00111001,&#57;,9,Nine
58,3A,00111010,&#58;,:,Colon
59,3B,00111011,&#59;,;,Semicolon
60,3C,00111100,&#60;,<,Less than
61,3D,00111101,&#61;,=,Equality sign
62,3E,00111110,&#62;,>,Greater than
63,3F,00111111,&#63;,?,Question mark
64,40,01000000,&#64;,@,At sign
65,41,01000001,&#65;,A,Capital A
66,42,01000010,&#66;,B,Capital B
67,43,01000011,&#67;,C,Capital C
68,44,01000100,&#68;,D,Capital D
69,45,01000101,&#69;,E,Capital E
70,46,01000110,&#70;,F,Capital F
71,47,01000111,&#71;,G,Capital G
72,48,01001000,&#72;,H,Capital H
73,49,01001001,&#73;,I,Capital I
74,4A,01001010,&#74;,J,Capital J
75,4B,01001011,&#75;,K,Capital K
76,4C,01001100,&#76;,L,Capital L
77,4D,01001101,&#77;,M,Capital M
78,4E,01001110,&#78;,N,Capital N
79,4F,01001111,&#79;,O,Capital O
80,50,01010000,&#80;,P,Capital P
81,51,01010001,&#81;,Q,Capital Q
82,52,01010010,&#82;,R,Capital R
83,53,01010011,&#83;,S,Capital S
84,54,01010100,&#84;,T,Capital T
85,55,01010101,&#85;,U,Capital U
86,56,01010110,&#86;,V,Capital V
87,57,01010111,&#87;,W,Capital W
88,58,01011000,&#88;,X,Capital X
89,59,01011001,&#89;,Y,Capital Y
90,5A,01011010,&#90;,Z,Capital Z
91,5B,01011011,&#91;,[,Left square bracket
92,5C,01011100,&#92;,\,Backslash
93,5D,01011101,&#93;,],Right square bracket
94,5E,01011110,&#94;,^,Caret / circumflex
95,5F,01011111,&#95;,_,Underscore
96,60,01100000,&#96;,`,Grave / accent
97,61,01100001,&#97;,a,Small a
98,62,01100010,&#98;,b,Small b
99,63,01100011,&#99;,c,Small c
100,64,01100100,&#100;,d,Small d
101,65,01100101,&#101;,e,Small e
102,66,01100110,&#102;,f,Small f
103,67,01100111,&#103;,g,Small g
104,68,01101000,&#104;,h,Small h
105,69,01101001,&#105;,i,Small i
106,6A,01101010,&#106;,j,Small j
107,6B,01101011,&#107;,k,Small k
108,6C,01101100,&#108;,l,Small l
109,6D,01101101,&#109;,m,Small m
110,6E,01101110,&#110;,n,Small n
111,6F,01101111,&#111;,o,Small o
112,70,01110000,&#112;,p,Small p
113,71,01110001,&#113;,q,Small q
114,72,01110010,&#114;,r,Small r
115,73,01110011,&#115;,s,Small s
116,74,01110100,&#116;,t,Small t
117,75,01110101,&#117;,u,Small u
118,76,01110110,&#118;,v,Small v
119,77,01110111,&#119;,w,Small w
120,78,01111000,&#120;,x,Small x
121,79,01111001,&#121;,y,Small y
122,7A,01111010,&#122;,z,Small z
123,7B,01111011,&#123;,{,Left curly bracket
124,7C,01111100,&#124;,|,Vertical bar
125,7D,01111101,&#125;,},Right curly bracket
126,7E,01111110,&#126;,~,Tilde
127,7F,01111111,&#127;,DEL,Delete""")
text_split = TextSplit(Text=panel_2, Separators=",")

# ---- group: Color 1s with Orange
boundary_surfaces = BoundarySurfaces(Edges=sift_pattern.Output1)
custom_preview = CustomPreview(Geometry=boundary_surfaces, Material=ColourSwatch(SwatchColor=RGB(255, 108, 83)))

# ---- group: Color 0s with White
boundary_surfaces_2 = BoundarySurfaces(Edges=sift_pattern.Output0)
custom_preview_2 = CustomPreview(Geometry=boundary_surfaces_2, Material=ColourSwatch(SwatchColor=RGB(255, 255, 255)))

# ---- group: Decimal Numbers
panel_3 = Panel(mass_addition.Result)

# ---- group: Reconstruct the Ring Structures
trim_tree = TrimTree(Tree=panel_3, Depth=1)

# ---- group: The outer ring has different rules than the other 3, so we can split it off.
split_tree = SplitTree(Data=trim_tree, Masks=flatten("{3}"))  # -> Positive, Negative

# ---- group: Get Indexed List of ASCII Characters
list_item_2 = ListItem(List=text_split, Index=0, Wrap=True)  # -> Item, Item1, Item2, Item3, Item4
flatten_tree = FlattenTree(Tree=list_item_2.Item4, Path="{0}")

# ---- group: The outer ring has a 2 character offset
shift_list = ShiftList(List=split_tree.Positive, Shift=Slider(2, range=0..10), Wrap=True)

# ---- group: Convert to ASCII Codes - Letters start at 2^6 (64)
addition = Addition(A=split_tree.Negative, B="64")

# ---- group: Look up letters by their index
# Orange is okay here!
# 
# The message uses really large numbers to encode empty space.
# 
# When we look up those values, there is no letter to match, which is exactly what we want.
# 
# If we leave “wrap” enabled, the indices will loop around and find “?”, which is kind of funny.
list_item_3 = ListItem(List=flatten_tree, Index=addition, Wrap=Toggle(False))

# ---- group: Each ring has a different offset
merge = Merge(Data1=Slider(2, range=0..10), Data2=Slider(6, range=0..10), Data3=Slider(4, range=0..10))
graft_tree = GraftTree(Tree=merge, IncludeEmptyLists=True, IncludeNullItems=True)
shift_list_2 = ShiftList(List=list_item_3, Shift=graft_tree, Wrap=True)

# ---- group: Clean up structure
simplify_tree = SimplifyTree(Tree=shift_list, Front=False)

# ---- group: The message here is in AAAB AAAB structure
partition_list_2 = PartitionList(List=simplify_tree, Size="4")

# ---- group: Split A from B Stream
split_list = SplitList(List=partition_list_2, Index="3")  # -> ListA, ListB

# ---- group: Convert B-Stream to ASCII Codes - Letters start at 2^6 (64)
# The B stream are ASCII characters like the rest of the message.
panel_4 = Panel("64")
addition_2 = Addition(A=split_list.ListB, B=panel_4)

# ---- group: Join the rings back into a single word
text_join_2 = TextJoin(Text=shift_list_2)

# ---- group: Add formatting characters
panel_5 = Panel("""°
'
"
""")
# The A stream are just numbers, no need to convert to ASCII. But, they are a special kind of number, so let’s toss in some formatting characters for degrees, minutes, and seconds on long/lat.
weave = Weave(Pattern=[0, 1], Stream0=split_list.ListA, Stream1=panel_5, NullGaps=False)

# ---- group: Remove all branching structure
flatten_tree_2 = FlattenTree(Tree=text_join_2, Path="{0}")

# ---- group: Look for a small subset of known ASCII character codes
panel_6 = Panel("""78
69
83
87""")
panel_7 = Panel("""N 
E 
S 
W """)
number = Number(addition_2)
number_2 = Number(panel_6)
replace_members = ReplaceMembers(Set=number, Find=number_2, Replace=panel_7)

# ---- group: Join words into a statement
# ^
# That panel has a space inside of it so that the words are separated by a space.
panel_8 = Panel(" ")
text_join_3 = TextJoin(Text=flatten_tree_2, Join=panel_8)

# ---- group: Join numbers with a period
text_join_4 = TextJoin(Text=weave)

# ----
image_sampler_2 = ImageSampler(
    FilePath="/Users/zap/Desktop/Screen Shot 2021-02-24 at 7.20.27 PM.png",
    Filter="Colour",
    Interpolate=False,
    Umax=1,
    Umin=0,
    Vmax=1,
    Vmin=0,
    Wrap=1)
panel_9 = Panel(text_join_3)

# ---- group: Put A and B streams back together
merge_2 = Merge(Data1=text_join_4, Data2=replace_members)

# ---- group: Remove structure and join text back together
flatten_tree_3 = FlattenTree(Tree=merge_2, Path="{0}")
text_join_5 = TextJoin(Text=flatten_tree_3)

# ----
# Google Maps these coordinate!
# 
# 34°11'58"N 118°10'31"W
# 
# You’ll find NASA’s Jet Propulsion Laboratory nearby!
# 
# Relevant: https://xkcd.com/2170/
panel_10 = Panel(text_join_5)
# https://www.google.com/maps/place/34°11'58.0%22N+118°10'31.0%22W/@34.1994444,-118.1752778,17z/data=!3m1!4b1!4m5!3m4!1s0x0:0x0!8m2!3d34.1994444!4d-118.1752778
image_sampler_3 = ImageSampler(
    FilePath="/Users/zap/Desktop/Screen Shot 2021-02-24 at 7.18.34 PM.png",
    Filter="Colour",
    Interpolate=False,
    Umax=1,
    Umin=0,
    Vmax=1,
    Vmin=0,
    Wrap=1)
