# Grasshopper definition trees-definition.gh (Grasshopper 1.0.7)

# ---- group: Create Spread-Out Points
panel = Panel("6")
series = Series(Start=0, Step=Slider(1.5, range=0..10), Count=panel)
construct_point = ConstructPoint(XCoordinate=series, YCoordinate=0, ZCoordinate=0)

# ---- group: No such thing as a 0,1, or 2-sided polygon, so we start at 3 for triangles
series_2 = Series(Start=Slider(3, range=0..10), Step=1, Count=panel)

# ---- group: Draw Polygons
polygon = Polygon(Plane=construct_point, Radius=Slider(0.5, range=0..1), Segments=series_2, FilletRadius=0)  # -> Polygon, Length

# ---- group: Extract Vertices of Polygons
# Take a long look at the panel here ->
# 
# Notice how each polygon’s data is now in its own branch, and each branch has a different number of points inside of it.
discontinuity = Discontinuity(Curve=polygon.Polygon, Level=1)  # -> Points, Parameters
panel_2 = Panel(discontinuity.Points)

# ----
# If we further graft the discontinuity points data, we have an additional branch added for each vertex — so we can see the geometric structure more easily. The triangle has 3 branches, the hexagon has 6, etc. The tree is starting to look a bit wobbly.
# 
# Though this probbaly matches our mental model for the data structure, it is not particularly useful. When would we need just a single point like this? Can’t do much with just one point.
# Notice how the “Discontinuity” node automatically created new branches for each polygon’s vertices. 1 branch with 6 items, to 6 branches with (3,4,5,6,7,8) items. Even the connecting wire changed from a thick wire to a dashed wire, indicating that a data tree is now flowing, rather than a simple list.
# 
# Lots of nodes do this sort of grafting and flattening automatically.
param_viewer = ParamViewer(polygon.Polygon)
param_viewer_2 = ParamViewer(discontinuity.Points)
graft_tree = GraftTree(Tree=discontinuity.Points, IncludeEmptyLists=True, IncludeNullItems=True)
param_viewer_3 = ParamViewer(graft_tree)

# ---- group: Convert Points into their constituent numerical coordinate
deconstruct = Deconstruct(Point=panel_2)  # -> XComponent, YComponent, ZComponent

# ----
# The data structure has not changeed, we’ve only swapped our points for raw numbers.
# 
# Before Deconstruct
# Triangle(pt,pt,pt)
# Square(pt,pt,pt,pt)
# Pentagon(pt,pt,pt,pt,pt)
# 
# After Deconstruct
# Triangle(x,x,x)
# Square(x,x,x,x)
# Pentagon(x,x,x,x,x)
param_viewer_4 = ParamViewer(deconstruct.XComponent)
panel_3 = Panel(deconstruct.YComponent)
panel_4 = Panel(deconstruct.XComponent)

# ---- group: Weave the x and y coordinates together x,y,x,y,x,y…
weave = Weave(Pattern=[0, 1], Stream0=panel_4, Stream1=panel_3, NullGaps=False)

# ----
# This is weird right? The tree structure has still not changed!
# 
# Correct! The structure has not changed, but now there are twice the number of elements carried on each branch.
# 
# Before, we had one point, or one number (just the x or y value). But now, we’re carrying the numeric coordinates for x and y as elements on the same branch.
# 
# Before Weave
# Triangle(x,x,x)
# Square(x,x,x,x)
# Pentagon(x,x,x,x,x)
# 
# After Weave
# Triangle(x,y,x,y,x,y)
# Square(x,y,x,y,x,y,x,y)
# Pentagon(x,y,x,y,x,y,x,y,x,y)
# 
# Identical structure, but double the data.
tree_statistics = TreeStatistics(Tree=panel_3)  # -> Paths, Length, Count
tree_statistics_2 = TreeStatistics(Tree=weave)  # -> Paths, Length, Count
param_viewer_5 = ParamViewer(weave)
panel_5 = Panel(tree_statistics.Length)
panel_6 = Panel(tree_statistics_2.Length)

# ----
# We now have a stream of numbers, separated by polygon.
# 
# Triangle(x,y,x,y,x,y)
# Square(x,y,x,y,x,y,x,y)
# Pentagon(x,y,x,y,x,y,x,y,x,y)
# 
# and so on.
# 
# This is very similar to how the data for the neighborhood boundaries was structured in the grocery store demo last week.
param_viewer_6 = ParamViewer(weave)
panel_7 = Panel(weave)

# ---- group: Partition Coordinates into [x,y] child branches
# The stream of numbers have now been grouped.
# 
# Triangle([x,y],[x,y],[x,y])
# Square([x,y],[x,y],[x,y],[x,y])
# Pentagon([x,y],[x,y],[x,y],[x,y],[x,y])
# 
# Our branches have branches!
# 
# This is now structured in such a way the Excel could not accurately show it. The data is nested/grouped twice, and so spreadsheet style programs would need to use color or some other communication convention to display this grouping.
number_slider = Slider(2, range=0..10)
partition_list = PartitionList(List=panel_7, Size=number_slider)
param_viewer_7 = ParamViewer(partition_list)
panel_8 = Panel(partition_list)

# ---- group: Grab the x and the y, and make points again
list_item = ListItem(List=panel_8, Index=0, Wrap=True)  # -> Item, Item1
construct_point_2 = ConstructPoint(XCoordinate=list_item.Item, YCoordinate=list_item.Item1, ZCoordinate=0)

# ---- group: Failed Polyline, Too Much Branching
# Weird, right?
# 
# We build some points, and we know they are grouped by their source polygons.
# 
# So why does Polyline say that it can’t draw a line?
# 
# Because each point is in its own branch! These are the red branches in the param viewer below, and they are keeping our points separated from each other.
# 
# Polyline needs a stream of points to connect, so we need to *remove* some structure at this point.
panel_9 = Panel(construct_point_2)
polyline = PolyLine(Vertices=construct_point_2, Closed=False)
param_viewer_8 = ParamViewer(panel_9)

# ---- group: Failed Polyline, Too Little Branching
# So, when we’ve encountered this kind of issue before, we know to flatten!
# 
# But, the result is weird. We see one long polyline through all the points, rather than the individual polygons we started with.
# 
# Flattening removes *all* the structure, taking us back several steps to a single branch and stream of points. As a result, one weird long line.
# <- Turn this on to see the mess!
flatten_tree = FlattenTree(Tree=construct_point_2, Path="{0}")
panel_10 = Panel(flatten_tree)
polyline_2 = PolyLine(Vertices=flatten_tree, Closed=True)
param_viewer_9 = ParamViewer(flatten_tree)

# ---- group: Goldilocks Branching, Perfect Polylines!
# What we want to do is flatten, but not all the way! Designer always want nuanced compromises!
# 
# This is called ‘trimming’ the tree. It let’s us flatten a selectable number of levels.
# 
# Here, the default single level of flattening works perfectly.
# 
# Flattening further will kill all the branching, and show the same continuous polyline as directly above.
# If we wanted the absolute cleanest data, we could find fault with this structure.
# 
# Though it works well for reconstructing our polygons, it has more redundant structure than we need. This branching is left-over from when we needed individual branches for the coordinate pairs.
# 
# Look at the“simplify tree” node example at the end of the long stream below for more explanation. But, to put it briefly, simplify tree just cuts out any branches that are shared between all elements in the tree.
# 
# Minimum structure = maximum clarity, but often we lose structural information that might be useful should we need to do additional operations on our geometry. In general, don’t worry about simplifying until the very end of Grasshopper flows.
number_slider_2 = Slider(1, range=0..10)
trim_tree = TrimTree(Tree=construct_point_2, Depth=number_slider_2)
param_viewer_10 = ParamViewer(trim_tree)
# <- Turn this on to see success!
polyline_3 = PolyLine(Vertices=trim_tree, Closed=True)
simplify_tree = SimplifyTree(Tree=trim_tree, Front=False)
param_viewer_11 = ParamViewer(simplify_tree)

# ---- group: Coloring as a Set
# Since the x-values are flattened in this version, the bounds node finds the min and max of all the polygon coordinates!
# 
# So, it spits out a minimum value from the triangle, and a maximum value from the octagon.
# 
# We have often used this behavior in the past to ensure gradients are produced based on the min and max of all elements, rather than just internal branched groupings.
number_slider_3 = Slider(1, range=0..10)
trim_tree_2 = TrimTree(Tree=construct_point_2, Depth=number_slider_3)
deconstruct_2 = Deconstruct(Point=trim_tree_2)  # -> XComponent, YComponent, ZComponent
flatten_tree_2 = FlattenTree(Tree=deconstruct_2.XComponent, Path="{0}")
bounds = Bounds(Numbers=flatten_tree_2)
panel_11 = Panel(bounds)
remap_numbers = RemapNumbers(Value=deconstruct_2.XComponent, Source=bounds, Target=Domain(0, 1))  # -> Mapped, Clipped
gradient = Gradient(
    LowerLimit=0,
    UpperLimit=1,
    Parameter=remap_numbers.Mapped,
    stops=[0: RGB(234, 38, 0), 0.25: RGB(234, 126, 0), 0.5: RGB(254, 244, 84), 0.75: RGB(173, 203, 249), 1: RGB(75, 107, 169)])
# <- Turn this preview on and compare it with the one above!
custom_preview = CustomPreview(Geometry=trim_tree_2, Material=gradient)

# ---- group: Coloring by Polygon
# We can trim the tree and use the resulting points’ x-coordinates to color the points.
# 
# See how each shape shows the whole gradient? Since each polygon’s vertices are in their own branch, the bounds node finds the min and max x-value in each polygon branch and maps those values to the left and right side of the gradient.
# 
# Compare this behavior with the alternative below.
number_slider_4 = Slider(1, range=0..10)
trim_tree_3 = TrimTree(Tree=construct_point_2, Depth=number_slider_4)
deconstruct_3 = Deconstruct(Point=trim_tree_3)  # -> XComponent, YComponent, ZComponent
bounds_2 = Bounds(Numbers=deconstruct_3.XComponent)
panel_12 = Panel(bounds_2)
remap_numbers_2 = RemapNumbers(Value=deconstruct_3.XComponent, Source=bounds_2, Target=Domain(0, 1))  # -> Mapped, Clipped
gradient_2 = Gradient(
    LowerLimit=0,
    UpperLimit=1,
    Parameter=remap_numbers_2.Mapped,
    stops=[0: RGB(234, 38, 0), 0.25: RGB(234, 126, 0), 0.5: RGB(254, 244, 84), 0.75: RGB(173, 203, 249), 1: RGB(75, 107, 169)])
# <- Turn this preview on! Then turn it off and compare with the one below.
custom_preview_2 = CustomPreview(Geometry=trim_tree_3, Material=gradient_2)

# ---- group: Extra Grafting
# If we graft the stream of partitioned x and y pairs, we produce an interesting looking tree.
# 
# Triangle([[x],[y]],[[x],[y]],[[x],[y]])
# Square([[x],[y]],[[x],[y]],[[x],[y]],[[x],[y]])
# 
# This looks like a lot of structure and is not all that useful now, but extra branching like this is often required in more complex Grasshopper projects.
# 
# For example, imagine an architect designing an organic building facade where each window is uniquely fabricated.
# 
# Building->Floor->Room->Window->Upper Left Corner->Spatial Coordinates->Material Thickness in Each Dimension-> and so on…
graft_tree_2 = GraftTree(Tree=panel_8, IncludeEmptyLists=True, IncludeNullItems=True)
param_viewer_12 = ParamViewer(graft_tree_2)
panel_13 = Panel(graft_tree_2)

# ---- group: Grafting to the Max!!!
# Zach said grafting is good, so let’s keep on grafting!
# 
# Notice, though, that at this point the structure isn’t really changing. We’re just adding extra extensions onto the branches, with no real new grouping happening.
# 
# Grafting extends off existing branches, it cannot introduce new branches closer to the trunk of the tree.
# We’ve introduced a ton of additional structure, but much of it is redundant.
graft_tree_3 = GraftTree(Tree=panel_13, IncludeEmptyLists=True, IncludeNullItems=True)
param_viewer_13 = ParamViewer(graft_tree_3)
graft_tree_4 = GraftTree(Tree=graft_tree_3, IncludeEmptyLists=True, IncludeNullItems=True)
param_viewer_14 = ParamViewer(graft_tree_4)
panel_14 = Panel(graft_tree_4)

# ---- group: Cleaning up Messy Data Trees
# Simplify is very useful. It cuts and glues branches together so that only meaningful branching remains.
# 
# It will only non-destructively adjust your data branches, taking away only structure that is shared exactly by all elements in a branch or are totally empty.
# 
# Notice it even took away the original “trunk” of our data, since that was a shared branch by all of our polygons, it was redundant — along with all the extra grafted branches from the last few steps.
# 
# Rarely will Simplify solve any Grasshopper problem, and is not really ever required to do anything. It is instead more of a “keeping your data clean” kind of node, making it easier to spot other branch-related troubles.
simplify_tree_2 = SimplifyTree(Tree=panel_14, Front=False)
param_viewer_15 = ParamViewer(simplify_tree_2)

# ---- group: Flattening cleans up too, by oblitering everything
# Don’t mix up simplifying with flattening!
# 
# Simplifying takes away *redundant* branching structure.
# 
# Flattening takes away *all* branching structure.
flatten_tree_3 = FlattenTree(Tree=simplify_tree_2, Path="{0}")
param_viewer_16 = ParamViewer(flatten_tree_3)
