# Grasshopper definition twists-definition.gh (Grasshopper 1.0.7)

# ---- group: Create Spread-Out Points
panel = Panel("6")
series = Series(Start=0, Step=Slider(2.2, range=0..10), Count=panel)
construct_point = ConstructPoint(XCoordinate=series, YCoordinate=0, ZCoordinate=0)

# ---- group: No such thing as a 0,1, or 2-sided polygon, so we start at 3 for triangles
series_2 = Series(Start=Slider(3, range=0..10), Step=1, Count=panel)

# ---- group: Draw Polygons
polygon = Polygon(Plane=construct_point, Radius=Slider(0.7, range=0..1), Segments=series_2, FilletRadius=0)  # -> Polygon, Length

# ----
param_viewer = ParamViewer(polygon.Polygon)

# ---- group: Rotation Control Sliders
radians = Radians(Degrees=[Slider(-65, range=-180..180), Slider(38, range=-180..180), Slider(123, range=-180..180), Slider(75, range=-180..180), Slider(-2, range=-180..180), Slider(-29, range=-180..180)])

# ---- group: Give each polygon its own branch
graft_tree = GraftTree(Tree=polygon.Polygon, IncludeEmptyLists=True, IncludeNullItems=True)

# ----
param_viewer_2 = ParamViewer(graft_tree)

# ---- group: Remove redundant structure
simplify_tree = SimplifyTree(Tree=graft_tree, Front=False)

# ----
param_viewer_3 = ParamViewer(simplify_tree)

# ---- group: Copy the polygons upwards, based on the number of rotation control sliders
list_length = ListLength(List=radians)
series_3 = Series(Start=0, Step=1, Count=list_length)
unit_z = UnitZ(Factor=series_3)
move = Move(Geometry=simplify_tree, Motion=unit_z)  # -> Geometry, Transform

# ----
# Because we collided our grafted Simplify Tree branch with a thick wire coming off of Unit Z, we grew an extra branch
param_viewer_4 = ParamViewer(move.Geometry)

# ---- group: Remove the extra structure introduced in the last step
simplify_tree_2 = SimplifyTree(Tree=move.Geometry, Front=False)

# ----
param_viewer_5 = ParamViewer(simplify_tree_2)

# ---- group: Give *each* set of polygons *all* of the rotation sliders
# The dashed wires are passing in the polygons in batched branches. The Rotate node is matching all of the values in the thick wire coming off Radians with each of the branches coming out of the identically-structured Area and Simplify Tree nodes.
# 
# We can read dashed wires as “each of the…” and thick wires as “all of the…”
area = Area(Geometry=simplify_tree_2)  # -> Area, Centroid
rotate = Rotate(Geometry=simplify_tree_2, Angle=radians, Plane=area.Centroid)  # -> Geometry, Transform

# ---- group: Extract rotated vertices
discontinuity = Discontinuity(Curve=rotate.Geometry, Level=1)  # -> Points, Parameters
# These two trees look almost the same but look closely - they have totally different structures.
param_viewer_6 = ParamViewer(discontinuity.Points)

# ---- group: Rearrange path structure
# WARNING: ADVANCED STUFF!: This is a “Path Mapper” node, which is the most powerful branch operator. It likely will make *no sense at all*, which is perfectly fine! For those interested in getting the most out of Grasshopper in the future, though, it will be a recurring puzzle.
# 
# Path Mapper transforms data structures *lexically* meaning you create your own labels for your tree structure, and describe the transformations you want to make. The node usually figures out what to do! It goes well beyond flattening and grafting, and allows you to transpose segments of trees, trim intermediate branches, and fluently move branches around.
# 
# Our stacks of polygonal points have a tree structure like so:
# 
# {PolygonalShapes;VerticalLevels}(Points)
# 
# So {1;2}(0) is the square (PolygonalShape 1), third level from the bottom (VerticalLevel 2), first point counted counter-clockwise from the right-hand side (Point 0)
# 
# Path Mapper is great if, for example, we wanted to draw curves up through equivalent points on each twisting level. Right now, we can’t do that, since our branches full of points are organized by level — so we cannot connect any point with its neighbors on another level. So what we need to do is very similar to what we would do in Excel by *transposing* our data, but we only want to rearrange the two outer layers of branches, without disturbing our polygonal groupings.
# 
# Path Mapper saves the day for these sorts of needs! The letters below are arbitrary - they are just placeholder names to show Grasshopper how you want to rearrange the tree.
# 
# Double-click on Path Mapper to edit the settings, and enter the following:
# 
# {A;B}(C) -> {A;C}(B)
# 
# The original {PolygonalShapes;VerticalLevels}(Points) becomes {PolygonalShapes;Points}(VerticalLevels).
# 
# So now, all the first points in the polygon stack are grouped together, as are all the second points…
# 
# This operation is super weird, but the power embedded in such transformation is why generative approaches are displacing traditional design tools!
path_mapper = PathMapper(discontinuity.Points, source="{A;B}(C) ", target="{A;C}(B)")
param_viewer_7 = ParamViewer(path_mapper)

# ---- group: Create a single, twisting surface from each set of polygons
loft = Loft(Curves=rotate.Geometry, Options={Adjust=False, Closed=False, LoftEnds=0, LoftSimp=0, LoftType=0, Rebuild=10, Refit=0.01})

# ----
param_viewer_8 = ParamViewer(loft)

# ---- group: Draw smooth curves up the sides of the forms
interpolate = Interpolate(Vertices=path_mapper, Degree=3, Periodic=False, KnotStyle=1)  # -> Curve, Length, Domain

# ---- group: Pipe the vertical curves
pipe = Pipe(Curve=interpolate.Curve, Radius=Slider(0.02, range=0..1), Caps=0)

# ---- group: Get rid of unnecessary branches
flatten_tree = FlattenTree(Tree=loft, Path="{0}")

# ----
param_viewer_9 = ParamViewer(flatten_tree)

# ---- group: Convert BRep to Mesh and get its parts
mesh_brep = MeshBrep(
    Brep=flatten_tree,
    Settings={GridMaxCount=0, GridMinCount=16, JaggedSeams=False, MaxEdgeLength=0, MinEdgeLength=0.0001, MinTolerance=0, Refine=True, RefineAngle=0, RelativeTolerance=0.65, SimplePlanes=True, Tolerance=0})
deconstruct_mesh = DeconstructMesh(Mesh=mesh_brep)  # -> Vertices, Faces, Colours, Normals

# ----
# Deconstruct Mesh, like other nodes like Discontinuity, have an implicit “Graft” and create a branch for each data element they receive.
param_viewer_10 = ParamViewer(deconstruct_mesh.Vertices)
custom_preview = CustomPreview(Geometry=pipe, Material=ColourSwatch(SwatchColor=RGB(114, 0, 255)))

# ---- group: Get color for each vertex based on X Value
# <- Try connecting this to the Bounds node “Numbers” input to see a different coloring logic.
# 
# Why does it change?
deconstruct = Deconstruct(Point=deconstruct_mesh.Vertices)  # -> XComponent, YComponent, ZComponent
flatten_tree_2 = FlattenTree(Tree=deconstruct.XComponent, Path="{0}")
bounds = Bounds(Numbers=deconstruct.XComponent)

# ----
panel_2 = Panel(bounds)

# ---- group: Get color for each vertex based on X Value (continued)
remap_numbers = RemapNumbers(Value=deconstruct.XComponent, Source=panel_2, Target=Domain(0, 1))  # -> Mapped, Clipped
gradient = Gradient(
    LowerLimit=0,
    UpperLimit=1,
    Parameter=remap_numbers.Mapped,
    stops=[0: RGB(148, 32, 146), 0.503: RGB(255, 147, 0), 1: RGB(255, 38, 0)])

# ---- group: Rebuild meshes
construct_mesh = ConstructMesh(Vertices=deconstruct_mesh.Vertices, Faces=deconstruct_mesh.Faces, Colours=gradient)

# ----
param_viewer_11 = ParamViewer(construct_mesh)
flatten_tree_3 = FlattenTree(Tree=construct_mesh, Path="{0}")
param_viewer_12 = ParamViewer(flatten_tree_3)
mesh = Mesh(flatten_tree_3)
