# Grasshopper definition polygon-definition.gh (Grasshopper 1.0.7)

# ---- group: Galapagos Points
gene_pool = GenePool(Decimals=2, Maximum=10, Minimum=0, Value=[1.09, 4.52, 2.29, 8.43, 4.57, 7.68, 6.51, 5.06, 7.69, 2.03, 2.03, 0.08])
panel = Panel("""12 Genes
0-10 Domain
2 Decimals of Precision""")
numbers_to_points = NumbersToPoints(Numbers=gene_pool, Mask="XY")

# ---- group: Draw Closed Curve
polyline = PolyLine(Vertices=numbers_to_points, Closed="True")

# ---- group: Penalty - are there any concavities?
convex_hull = ConvexHull(Points=numbers_to_points, Plane=PlaneXY(0, 0, 0))  # -> Hull, HullZ, Indices
discontinuity = Discontinuity(Curve=convex_hull.Hull, Level=1)  # -> Points, Parameters

# ---- group: Penalty - How different are the lengths of the different legs?
segment_lengths = SegmentLengths(Curve=polyline)  # -> ShortestLength, ShortestDomain, LongestLength, LongestDomain
subtraction = Subtraction(A=segment_lengths.LongestLength, B=segment_lengths.ShortestLength)

# ---- group: Penalty - How many times does the curve self-intersect?
curve_self = CurveSelf(Curve=polyline)  # -> Points, Params
list_length = ListLength(List=curve_self.Points)

# ---- group: Visualize self-intersections
circle_cnr = CircleCNR(Center=curve_self.Points, Normal=Vector(0, 0, 1), Radius=Slider(0.391, range=0..1))

# ---- group: We would expect 6 points to be on the convex hull if it is drawing a polygon
list_length_2 = ListLength(List=discontinuity.Points)
subtraction_2 = Subtraction(A="6", B=list_length_2)

# ---- group: Reward - how much area have we contained?
area = Area(Geometry=polyline)  # -> Area, Centroid

# ---- group: Adjust the impactful of each penalty
multiplication = Multiplication(A=list_length, B=Slider(10, range=0..10))
multiplication_2 = Multiplication(A=subtraction, B=Slider(4, range=0..10))
multiplication_3 = Multiplication(A=subtraction_2, B=Slider(4, range=0..10))

# ---- group: Add all penalties
mass_addition = MassAddition(Input=flatten([multiplication, multiplication_2, multiplication_3]))  # -> Result, PartialResults

# ---- group: Subtract all penalties from reward
subtraction_3 = Subtraction(A=area.Area, B=mass_addition.Result)

# ----
# Double-click to open Galapagos
# |
# |
# V
galapagos = Galapagos(fitness=subtraction_3, gene=gene_pool)
