# Grasshopper definition subway-definition.gh (Grasshopper 1.0.7)

# ---- group: City!
number_slider = Slider(10, range=0..10)
rectangle = Rectangle(Plane=PlaneXY(0, 0, 0), XSize=number_slider, YSize=number_slider, Radius=0)  # -> Rectangle, Length

# ---- group: Subway Station Placement
gene_pool = GenePool(
    Decimals=2,
    Maximum=10,
    Minimum=0,
    Value=[2.48, 1.12, 1.74, 3.15, 0.79, 5.71, 2.41, 7.05, 5.14, 7.19, 8.3, 5.63, 9.49, 1.51, 5.7, 2.56])
numbers_to_points = NumbersToPoints(Numbers=gene_pool, Mask="XY")

# ---- group: Create Population Centers
population_center_count = Slider(10, range=0..10)
random_seed = Slider(42, range=0..100)
random = Random(Range=Domain(0, 1), Number=population_center_count, Seed=random_seed)
populate_2d = Populate2D(Region=rectangle.Rectangle, Count=population_center_count, Seed=random_seed)

# ---- group: Stations
point = Point(numbers_to_points)

# ---- group: Subway Path
polyline = PolyLine(Vertices=point, Closed=False)

# ---- group: Find nearest train station to each population center
closest_point = ClosestPoint(Point=populate_2d, Cloud=point)  # -> ClosestPoint, CPIndex, Distance

# ----
panel = Panel("<- to Station")
panel_2 = Panel("<- to Population Centers")

# ---- group: Get shortest distance for each station to nearest population center
graft_tree = GraftTree(Tree=point, IncludeEmptyLists=True, IncludeNullItems=True)
distance = Distance(PointA=graft_tree, PointB=populate_2d)
sort_list = SortList(Keys=distance)  # -> Keys, ValuesA
list_item = ListItem(List=sort_list.Keys, Index=0, Wrap=True)

# ---- group: Conditional Penalty: Check If the walking distance to the subway is larger than a set comfortable distance
walking_distance = Slider(1.12, range=0..10)
larger_than = LargerThan(FirstNumber=closest_point.Distance, SecondNumber=walking_distance)  # -> LargerThan, OrEqualTo
mass_addition = MassAddition(Input=larger_than.LargerThan)  # -> Result, PartialResults

# ---- group: Penalty: Turning Damages Trains, So Large Bends are Bad!
explode = Explode(Curve=polyline, Recursive=True)  # -> Segments, Vertices
shift_list = ShiftList(List=explode.Segments, Shift=1, Wrap=False)
angle = Angle(VectorA=explode.Segments, VectorB=shift_list)  # -> Angle, Reflex
mass_addition_2 = MassAddition(Input=angle.Angle)  # -> Result, PartialResults

# ---- group: Penalty: Does the Subway Self-Intersect?
curve_self = CurveSelf(Curve=polyline)  # -> Points, Params
list_length = ListLength(List=curve_self.Points)

# ---- group: Penalty: Walking Distance to Each Population Center Weighted by Population
multiplication = Multiplication(A=random, B=closest_point.Distance)
mass_addition_3 = MassAddition(Input=multiplication)  # -> Result, PartialResults

# ---- group: Population Center Visualization
circle_cnr = CircleCNR(Center=populate_2d, Normal=Vector(0, 0, 1), Radius=random)
boundary_surfaces = BoundarySurfaces(Edges=circle_cnr)

# ---- group: Penalty: Longer tracks are bad because construction is expensive!
length = Length(Curve=polyline)

# ---- group: Walking path and station use visualization
line = Line(StartPoint=populate_2d, EndPoint=closest_point.ClosestPoint)

# ---- group: Train line visualization
curve = Curve(polyline)

# ----
panel_3 = Panel(list_item)

# ---- group: Check if we are in walking distance
larger_than_2 = LargerThan(FirstNumber=panel_3, SecondNumber=Slider(1.25, range=0..10))  # -> LargerThan, OrEqualTo

# ----
custom_preview = CustomPreview(Geometry=boundary_surfaces, Material=ColourSwatch(SwatchColor=RGB(13, 219, 255)))
custom_preview_2 = CustomPreview(Geometry=line, Material=ColourSwatch(SwatchColor=RGB(13, 219, 255)))
custom_preview_3 = CustomPreview(Geometry=curve, Material=ColourSwatch(SwatchColor=RGB(200, 255, 0)))

multiplication_2 = Multiplication(A=length, B=Slider(5, range=0..10))

multiplication_3 = Multiplication(A=mass_addition_3.Result, B=Slider(5, range=0..10))

multiplication_4 = Multiplication(A=list_length, B=Slider(5, range=0..10))

multiplication_5 = Multiplication(A=mass_addition.Result, B=Slider(5, range=0..10))

multiplication_6 = Multiplication(A=mass_addition_2.Result, B=Slider(5, range=0..10))

# ---- group: count how many stations are outside walking distance of a population center
flatten_tree = FlattenTree(Tree=larger_than_2.LargerThan, Path="{0}")
mass_addition_4 = MassAddition(Input=flatten_tree)  # -> Result, PartialResults
panel_4 = Panel(mass_addition_4.Result)

# ---- group: Weight
# to flatten tree ->
multiplication_7 = Multiplication(A=panel_4, B=Slider(5, range=0..10))

# ---- group: Remove any accidental structure
flatten_tree_2 = FlattenTree(
    Tree=[multiplication_3, multiplication_2, multiplication_4, multiplication_5, multiplication_6, multiplication_7],
    Path="{0}")

# ---- group: Add up all penalties
mass_addition_5 = MassAddition(Input=flatten_tree_2)  # -> Result, PartialResults

# ---- group: We have no rewards, but to save a click, we can try to 'maximize' a whole bunch of negative numbers.
subtraction = Subtraction(A="0", B=mass_addition_5.Result)

# ----
# Double-Click to Run Galapagos.
galapagos = Galapagos(fitness=subtraction, gene=gene_pool)
