# Grasshopper definition tangram-definition.gh (Grasshopper 1.0.7)

number_slider = Slider(10, range=0..10)

# ---- group: Slice Tangrams
rectangle = Rectangle(Plane=PlaneXY(0, 0, 0), XSize=number_slider, YSize=number_slider, Radius=0)  # -> Rectangle, Length
# Slice up the starting rectangle into pieces by drawing lines in Rhino.
# 
# Right Click -> Set Multiple Curves
curve = Curve([<curve referenced from the Rhino model> x4])
surface_split = SurfaceSplit(Surface=rectangle.Rectangle, Curves=curve)
brep_edges = BrepEdges(Brep=surface_split)  # -> Naked, Interior, NonManifold
join_curves = JoinCurves(Curves=brep_edges.Naked, Preserve=False)

# ---- group: Free Rotate
flatten_tree = FlattenTree(Tree=join_curves, Path="{0}")
gene_pool = GenePool(Decimals=0, Maximum=8, Minimum=0, Value=[1, 1, 1, 3, 3])
area = Area(Geometry=flatten_tree)  # -> Area, Centroid
radians = Radians(Degrees=Slider(45, range=0..100))
multiplication = Multiplication(A=gene_pool, B=radians)
rotate = Rotate(Geometry=flatten_tree, Angle=multiplication, Plane=area.Centroid)  # -> Geometry, Transform

# ---- group: Free Move
gene_pool_2 = GenePool(Decimals=2, Maximum=20, Minimum=-20, Value=[1.17, 0.59, -11.56, 4.41, -4.64])
gene_pool_3 = GenePool(Decimals=2, Maximum=20, Minimum=-20, Value=[-0.84, -4.39, 4.78, 4.34, 0.79])
vector_xyz = VectorXYZ(XComponent=gene_pool_2, YComponent=gene_pool_3, ZComponent=0)  # -> Vector, Length
move = Move(Geometry=rotate.Geometry, Motion=vector_xyz.Vector)  # -> Geometry, Transform

# ---- group: Overlapping Shape in Shape Check
area_2 = Area(Geometry=move.Geometry)  # -> Area, Centroid
graft_tree = GraftTree(Tree=area_2.Centroid, IncludeEmptyLists=True, IncludeNullItems=True)
point_in_curve = PointInCurve(Point=graft_tree, Curve=move.Geometry)  # -> Relationship, Point
list_length = ListLength(List=area_2.Centroid)
flatten_tree_2 = FlattenTree(Tree=point_in_curve.Relationship, Path="{0}")
# Each piece will see its own center as inside of itself, and we don’t want to penalize Galapagos for that. So, we remove 2 * (number of pieces) from the penalty. The 2 comes from the output from the "point in curve" node, which give 0 for outside, 1 for on the curve, and 2 for inside.
multiplication_2 = Multiplication(A="2", B=list_length)
mass_addition = MassAddition(Input=flatten_tree_2)  # -> Result, PartialResults
subtraction = Subtraction(A=mass_addition.Result, B=multiplication_2)
multiplication_3 = Multiplication(A=subtraction, B=Slider(5, range=0..10))

# ----
# Draw your target profile in Rhino
# 
# Right Click -> Set One Curve
curve_2 = Curve(<curve referenced from the Rhino model>)

# ---- group: Good!
region_intersection = RegionIntersection(CurvesA=move.Geometry, CurvesB=curve_2)
area_3 = Area(Geometry=region_intersection)  # -> Area, Centroid
mass_addition_2 = MassAddition(Input=area_3.Area)  # -> Result, PartialResults

# ---- group: Missing Area Left Unfilled
area_4 = Area(Geometry=move.Geometry)  # -> Area, Centroid
mass_addition_3 = MassAddition(Input=area_4.Area)  # -> Result, PartialResults
subtraction_2 = Subtraction(A=mass_addition_3.Result, B=mass_addition_2.Result)
multiplication_4 = Multiplication(A=subtraction_2, B=Slider(5, range=0..10))

# ---- group: Tangram Piece Collision Check
multiple_curves = MultipleCurves(Curves=move.Geometry)  # -> Points, IndexA, IndexB, ParamA, ParamB
list_length_2 = ListLength(List=multiple_curves.Points)
multiplication_5 = Multiplication(A=list_length_2, B=Slider(10, range=0..10))

# ----
boundary_surfaces = BoundarySurfaces(Edges=graft(region_intersection))

# ---- group: All Penalities added together
mass_addition_4 = MassAddition(Input=flatten([multiplication_5, multiplication_4, multiplication_3]))  # -> Result, PartialResults

# ----
subtraction_3 = Subtraction(A=mass_addition_2.Result, B=mass_addition_4.Result)
galapagos = Galapagos(fitness=subtraction_3, gene=[gene_pool_3, gene_pool_2, gene_pool])
