# Grasshopper definition solar-carve-definition.gh (Grasshopper 1.0.4)

# ---- group: Roof Height and Shape
number_slider = Slider(18.5, range=5..20)
construct_point = ConstructPoint(XCoordinate=0, YCoordinate=0, ZCoordinate=number_slider)
number_slider_2 = Slider(6.74, range=0..10)
number_slider_3 = Slider(7, range=3..10)
xy_plane = XYPlane(Origin=construct_point)
polygon = Polygon(Plane=xy_plane, Radius=number_slider_2, Segments=number_slider_3, FilletRadius=0)  # -> Polygon, Length

# ---- group: Base Shape
construct_point_2 = ConstructPoint(XCoordinate=0, YCoordinate=0, ZCoordinate=0)
number_slider_4 = Slider(7, range=3..10)
number_slider_5 = Slider(10, range=0..10)
polygon_2 = Polygon(Plane=construct_point_2, Radius=number_slider_5, Segments=number_slider_4, FilletRadius=0)  # -> Polygon, Length

# ---- group: The Sun!
construct_point_3 = ConstructPoint(XCoordinate=Slider(75, range=0..100), YCoordinate=Slider(55, range=0..100), ZCoordinate=Slider(100, range=0..100))
sphere = Sphere(Base=construct_point_3, Radius=5)

# ---- group: Double Click to Run Galapagos
galapagos = Galapagos(
    fitness=subtraction,
    gene=[number_slider_8, number_slider_7, number_slider_6, number_slider_2, number_slider_3, number_slider_4, number_slider_5, number_slider])

# ---- group: Rotate on XY
number_slider_6 = Slider(83, range=0..360)
xy_plane_2 = XYPlane(Origin=construct_point)

# ----
radians = Radians(Degrees=number_slider_6)

# ---- group: Rotate on XY (continued)
rotate = Rotate(Geometry=polygon.Polygon, Angle=radians, Plane=xy_plane_2)  # -> Geometry, Transform

# ---- group: Rotate on YZ
number_slider_7 = Slider(17, range=-30..30)
yz_plane = YZPlane(Origin=construct_point)

# ----
radians_2 = Radians(Degrees=number_slider_7)

# ---- group: Rotate on YZ (continued)
rotate_2 = Rotate(Geometry=rotate.Geometry, Angle=radians_2, Plane=yz_plane)  # -> Geometry, Transform

# ---- group: Rotate on XZ
number_slider_8 = Slider(-13, range=-30..30)
xz_plane = XZPlane(Origin=construct_point)

# ----
radians_3 = Radians(Degrees=number_slider_8)

# ---- group: Rotate on XZ (continued)
rotate_3 = Rotate(Geometry=rotate_2.Geometry, Angle=radians_3, Plane=xz_plane)  # -> Geometry, Transform

# ---- group: Create 3D Form
loft = Loft(
    Curves=[polygon_2.Polygon, rotate_3.Geometry],
    Options={Adjust=False, Closed=False, LoftEnds=0, LoftSimp=0, LoftType=0, Rebuild=10, Refit=0.01})
cap_holes = CapHoles(Brep=loft)

# ---- group: Building Color
colour_picker = ColourPicker(PickedColour=RGB(37, 170, 244))
custom_preview = CustomPreview(Geometry=cap_holes, Shader=colour_picker)

# ---- group: Mesh and Create Shadow
mesh_brep = MeshBrep(
    Brep=cap_holes,
    Settings={GridMaxCount=0, GridMinCount=16, JaggedSeams=False, MaxEdgeLength=0, MinEdgeLength=0.0001, MinTolerance=0, Refine=True, RefineAngle=0, RelativeTolerance=0.65, SimplePlanes=True, Tolerance=0})
mesh_shadow = MeshShadow(Mesh=mesh_brep, Light=construct_point_3, Plane=PlaneXY(0, 0, 0))
boundary_surfaces = BoundarySurfaces(Edges=mesh_shadow)

# ---- group: Shadow Color
colour_picker_2 = ColourPicker(PickedColour=RGB(0, 0, 0))
custom_preview_2 = CustomPreview(Geometry=boundary_surfaces, Shader=colour_picker_2)

# ---- group: Calculate Area of Shadow
area = Area(Geometry=mesh_shadow)  # -> Area, Centroid
mass_addition = MassAddition(Input=area.Area)  # -> Result, PartialResults

# ---- group: Subtract Shadow Area from Volume
volume = Volume(Geometry=cap_holes)  # -> Volume, Centroid
subtraction = Subtraction(A=volume.Volume, B=mass_addition.Result)
